# Dynamo graph Filtering Elements with booMask.dyn (Dynamo 2.19.3.6394)
# packages: Genius Loci 2023.2.21

categories = Categories("OST_DuctTerminal")
all_elements_of_category = ElementsOfCategory(Category=categories)
string = StringInput("System Classification")
getParameterValueByName = Element.GetParameterValueByName(element=all_elements_of_category, parameterName=string)
string_2 = StringInput("Supply Air")
contains = String.Contains(string=getParameterValueByName, searchFor=string_2)
filterByBoolMask = List.FilterByBoolMask(list=all_elements_of_category, mask=contains)
string_3 = StringInput("System Name")
getParameterValueByName_2 = Element.GetParameterValueByName(element=filterByBoolMask.in, parameterName=string_3)
string_4 = StringInput("Mechanical Supply Air 31")
contains_2 = String.Contains(string=getParameterValueByName_2, searchFor=string_4)
filterByBoolMask_2 = List.FilterByBoolMask(list=all_elements_of_category, mask=contains_2)
watch = Watch(filterByBoolMask_2.in)
watch_2 = Watch(filterByBoolMask.in)
groupByFunction = List.GroupByFunction(list=getParameterValueByName_2)  # unwired: groupFunction
code_block = CodeBlock { 1..50; }
list_create = List.Create(item0=code_block)
list_create_2 = List.Create(item0=getParameterValueByName_2)
list_sortnatural = Custom[List SortNatural](list=list_create_2)  # package Genius Loci; Sorts a specified list in natural order in either ascending or descending order.
