# Dynamo graph Get Elements ID.dyn (Dynamo 2.19.3.6394)

categories = Categories("OST_Walls")
all_elements_of_category = ElementsOfCategory(Category=categories)
id = Element.Id(element=all_elements_of_category)
