# Dynamo graph Get the Height of a Wall Element.dyn (Dynamo 2.19.3.6394)

categories = Categories("OST_Walls")
all_elements_of_category = ElementsOfCategory(Category=categories)
code_block = CodeBlock { "Length"; }
getParameterValueByName = Element.GetParameterValueByName(element=all_elements_of_category, parameterName=code_block)
sum = Math.Sum(values=getParameterValueByName)
