# Dynamo graph Script_101 Automate project setup.dyn (Dynamo 2.16.2.5624)

# group: Import Data from Excel
file_path = Filename(".\Project Setup.xlsx")
file_from_path = FileObject(path=file_path)
code_block = CodeBlock { "Sheet1_Levels"; }
importExcel = Data.ImportExcel(file=file_from_path, sheetName=code_block)
firstItem = List.FirstItem(list=importExcel)
restOfItems = List.RestOfItems(list=importExcel)
transpose = List.Transpose(lists=restOfItems)

# group: Floor plan data import from excel file
file_from_path_2 = FileObject(path=file_path)
code_block_2 = CodeBlock { "Floor Plans"; }
importExcel_2 = Data.ImportExcel(file=file_from_path_2, sheetName=code_block_2)
firstItem_2 = List.FirstItem(list=importExcel_2)
restOfItems_2 = List.RestOfItems(list=importExcel_2)
transpose_2 = List.Transpose(lists=restOfItems_2)

# group: Import sheet Names from Excel file
file_from_path_3 = FileObject(path=file_path)
code_block_3 = CodeBlock { "Sheet Name"; }
importExcel_3 = Data.ImportExcel(file=file_from_path_3, sheetName=code_block_3)
firstItem_3 = List.FirstItem(list=importExcel_3)
restOfItems_3 = List.RestOfItems(list=importExcel_3)
transpose_3 = List.Transpose(lists=restOfItems_3)

# group: Create levels
code_block_4 = CodeBlock { 0; 1; }
getItemAtIndex = List.GetItemAtIndex(list=transpose, index=code_block_4.out1)
getItemAtIndex_2 = List.GetItemAtIndex(list=transpose, index=code_block_4.out0)
byElevationAndName = Level.ByElevationAndName(elevation=getItemAtIndex, name=getItemAtIndex_2)

# group: Creating floor plans
code_block_5 = CodeBlock { 1; }
getItemAtIndex_3 = List.GetItemAtIndex(list=transpose_2, index=code_block_5)
indexOf = List.IndexOf(list=getItemAtIndex_2, element=getItemAtIndex_3)
getItemAtIndex_4 = List.GetItemAtIndex(list=byElevationAndName, index=indexOf)
byLevel = FloorPlanView.ByLevel(level=getItemAtIndex_4)

# group: Set Floor plan Names
code_block_6 = CodeBlock { "View Name"; }
code_block_7 = CodeBlock { 2; }
getItemAtIndex_5 = List.GetItemAtIndex(list=transpose_2, index=code_block_7)
setParameterByName = Element.SetParameterByName(element=byLevel, parameterName=code_block_6, value=getItemAtIndex_5)

# group: Create sheet
code_block_8 = CodeBlock { 0; 1; 2; }
getItemAtIndex_6 = List.GetItemAtIndex(list=transpose_3, index=code_block_8.out2)
getItemAtIndex_7 = List.GetItemAtIndex(list=transpose_3, index=code_block_8.out1)
getItemAtIndex_8 = List.GetItemAtIndex(list=transpose_3, index=code_block_8.out0)
family_types = FamilyTypes("DPR_Title Block_30x42 - Vc:Construction Drawing")
byNameNumberTitleBlockAndView = Sheet.ByNameNumberTitleBlockAndView(sheetName=getItemAtIndex_7, sheetNumber=getItemAtIndex_8, titleBlockFamilyType=family_types, view=setParameterByName)
