# Dynamo graph Sort a list Alphabetically.dyn (Dynamo 2.19.3.6394)
# packages: Genius Loci 2023.2.21

file_path = Filename("..\..\..\Downloads\Input File.xlsx")
file_from_path = FileObject(path=file_path)
string = StringInput("Sheet1")
importExcel = Data.ImportExcel(file=file_from_path, sheetName=string)
flatten = List.Flatten(list=importExcel)
list_sortnatural = Custom[List SortNatural](list=flatten)  # package Genius Loci; Sorts a specified list in natural order in either ascending or descending order.
sort = List.Sort(list=flatten)
