# Dynamo graph Sort a list of Numbers.dyn (Dynamo 2.19.3.6394)
# packages: Genius Loci 2023.2.21

categories = Categories("OST_StructuralColumns")
all_elements_of_category = ElementsOfCategory(Category=categories)
string = StringInput("Volume")
getParameterValueByName = Element.GetParameterValueByName(element=all_elements_of_category, parameterName=string)
list_sortnatural = Custom[List SortNatural](list=getParameterValueByName)  # package Genius Loci; Sorts a specified list in natural order in either ascending or descending order.
