# Dynamo graph To Calculate Area of wall.dyn (Dynamo 2.19.3.6394)

categories = Categories("OST_Walls")
all_elements_of_category = ElementsOfCategory(Category=categories)
string = StringInput("Area")
getParameterValueByName = Element.GetParameterValueByName(element=all_elements_of_category, parameterName=string)
sum = Math.Sum(values=getParameterValueByName)
